# Grasshopper definition 房间生成_YHN.gh (Grasshopper 1.0.7)
# plug-ins: MeshEdit Components, treesloth01, Anemone, Human, Wallacei, GH_CPython, TT Toolbox

rectangle = Rectangle(Plane=PlaneXY(0, 0, 0), XSize=Slider(32, range=0..100), YSize=Slider(48, range=0..100), Radius=0)  # -> Rectangle, Length
boundary_surfaces = BoundarySurfaces(Edges=rectangle.Rectangle)
divide_domain² = DivideDomain²(Domain=boundary_surfaces, UCount=Slider(4, range=0..10), VCount=Slider(6, range=0..10))
panel = Panel(boundary_surfaces)
isotrim = Isotrim(Surface=boundary_surfaces, Domain=divide_domain²)
area = Area(Geometry=isotrim)  # -> Area, Centroid
point_list = PointList(Points=area.Centroid, Size=Slider(3, range=0..10))
panel_2 = Panel("""0
6
12
18""")
panel_3 = Panel("""5
11
17
23""")
honeybee_bldgprograms = Honeybee_bldgPrograms({"Office": 0, "Retail": 1, "MidriseApartment": 2, "PrimarySchool": 3, "SecondarySchool": 4, "SmallHotel": 5, "LargeHotel": 6, "Hospital": 7, "Outpatient": 8, "Warehouse": 9, "SuperMarket": 10, "FullServiceRestaurant": 11, "QuickServiceRestaurant": 12}, selected="Office")
unit_z = UnitZ(Factor=Slider(4.2, range=0..10))

honeybee = Honeybee_Honeybee()  # -> out; plug-in component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
ladybug = Ladybug_Ladybug()  # -> out; plug-in component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

listzoneprograms = Honeybee_ListZonePrograms(bldgProgram=honeybee_bldgprograms)  # -> OfficeZonePrograms; plug-in component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
list_item = ListItem(List=listzoneprograms, Index=Slider(3, range=0..10), Wrap=True)
open_weather_file = Ladybug_OpenEPWWeatherFile(open=Slider(1, range=0..1))  # -> epwFile; plug-in component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
genstandardciesky = Honeybee_GenerateStandardCIESky(
    weatherFile=open_weather_file,
    month=Slider(6, range=0..10),
    day=Slider(21, range=0..100),
    hour=Slider(12, range=0..100),
    skyType=0)  # -> skyFilePath; plug-in component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
unit_z_2 = UnitZ(Factor=Slider(10, range=0..10))
unit_z_3 = UnitZ(Factor=Slider(-2, range=-10..0))
honeybee_bldgprograms_2 = Honeybee_bldgPrograms({"Office": 0, "Retail": 1, "MidriseApartment": 2, "PrimarySchool": 3, "SecondarySchool": 4, "SmallHotel": 5, "LargeHotel": 6, "Hospital": 7, "Outpatient": 8, "Warehouse": 9, "SuperMarket": 10, "FullServiceRestaurant": 11, "QuickServiceRestaurant": 12}, selected="Office")
listzoneprograms_2 = Honeybee_ListZonePrograms(bldgProgram=honeybee_bldgprograms_2)  # -> OfficeZonePrograms; plug-in component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
list_item_2 = ListItem(List=listzoneprograms_2, Index=Slider(3, range=0..10), Wrap=True)
colour_swatch = ColourSwatch(SwatchColor=RGB(255, 0, 0))
colour_swatch_2 = ColourSwatch(SwatchColor=RGB(35, 184, 87))
colour_swatch_3 = ColourSwatch(SwatchColor=RGB(22, 95, 140))
open_weather_file_2 = Ladybug_OpenEPWWeatherFile(open=Slider(1, range=0..1))  # -> epwFile; plug-in component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
number_slider = Slider(8760, range=0..10000)
number_slider_2 = Slider(2, range=0..10)
radparameters = Honeybee_RADParameters(quality=Slider(0, range=0..100))  # -> out, radParameters; plug-in component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
genstandardciesky_2 = Honeybee_GenerateStandardCIESky(
    weatherFile=open_weather_file_2,
    month=Slider(6, range=0..10),
    day=Slider(21, range=0..100),
    hour=Slider(12, range=0..100),
    skyType=0)  # -> skyFilePath; plug-in component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
gh_cpython = GH_CPython(input=number_slider_2, x=number_slider)  # -> output, a, b, c, d; inputs input: list, x: list
# ---------- gh_cpython: Python ----------
# -*- coding: utf-8 -*-
""" 
Python Script
Created on  Wednesday June 2021 07:20:31 
@author:  A434 

[desc]
Description of the plugin Here
Write here any thing... 
[/desc]

ARGUMENTS:
----------
<inp> 
    _input :[required] - [type = int] - [default = None] 
    Descripe your input here 
        * bullet point.
        * bullet point
</inp>
<inp>
    Other inputs go here ...
</inp>

RETURN:
----------
    <out>
        output_ : indicate your output description here. \n refers to a new line.
    </out>

"""

import numpy as np
import pandas as pd

### schedule type
SCHDULE_TIMEGAP = 2
SCHDULE = {
    0: [2, 2, 2, 2, 2, 2, 2, 2, 2, 2, 2, 2, 2, 2, 2, 2, 2, 2, 2, 2, 2, 2,
        2, 2, 2, 2, 2, 2, 2, 2, 2, 2, 2, 2, 2, 2, 2, 2, 2, 2, 2, 2, 2, 2,
        2, 2, 2, 2],
    1: [2, 2, 2, 2, 2, 2, 2, 2, 2, 2, 2, 2, 2, 2, 2, 2, 2, 2, 1, 0, 0, 0,
        5, 5, 0, 4, 4, 1, 0, 0, 0, 0, 0, 0, 5, 5, 1, 0, 0, 0, 2, 2, 2, 2,
        2, 2, 2, 2],
    2: [2, 2, 2, 2, 2, 2, 2, 2, 2, 2, 2, 2, 2, 2, 2, 2, 2, 2, 1, 0, 0, 0,
        5, 5, 0, 4, 4, 1, 0, 0, 0, 0, 0, 0, 2, 2, 2, 2, 2, 2, 2, 2, 2, 2,
        2, 2, 2, 2],
    3: [2, 2, 2, 2, 2, 2, 2, 2, 2, 2, 2, 2, 2, 2, 2, 2, 2, 2, 1, 0, 0, 0,
        5, 5, 0, 4, 4, 1, 0, 3, 3, 3, 3, 3, 5, 5, 1, 0, 0, 0, 2, 2, 2, 2,
        2, 2, 2, 2]}
### schdule choice
#holiday = pd.read_csv("holiday.csv",header = None)
#a = holiday.values.T.tolist()[0]
HOLIDAY = [  1,   2,   3,  42,  43,  44,  45,  46,  47,  48, 120, 121, 122,
           123, 124, 125, 164, 165, 166, 292, 293, 294, 322, 323, 324, 334,
           335, 336, 337, 338, 339, 340]
#weekend = pd.read_csv("weekend.csv",header = None)
#a = weekend.values.T.tolist()
#a[0].extend(a[1])
#a = a[0]
WEEKEND = [  6,  13,  20,  27,  34,  41,  48,  55,  62,  69,  76,  83,  90,
            97, 104, 111, 118, 125, 132, 139, 146, 153, 160, 167, 174, 181,
           188, 195, 202, 209, 216, 223, 230, 237, 244, 251, 258, 265, 272,
           279, 286, 293, 300, 307, 314, 321, 328, 335, 342, 349, 356, 363,
           370,   7,  14,  21,  28,  35,  42,  49,  56,  63,  70,  77,  84,
            91,  98, 105, 112, 119, 126, 133, 140, 147, 154, 161, 168, 175,
           182, 189, 196, 203, 210, 217, 224, 231, 238, 245, 252, 259, 266,
           273, 280, 287, 294, 301, 308, 315, 322, 329, 336, 343, 350, 357,
           364, 371]


# -------daytype and schedule-------
def daytype(timerange,timegap):
    df = pd.DataFrame(index = timerange)
    df["hourOfYear"] = df.index // timegap
    df["day"] = df["hourOfYear"] // 24
    df["hourOfDay"] = (df.index) % (24*timegap)
    
    restday = list(set(HOLIDAY) | set(WEEKEND))
    restday = [each - 1 for each in restday]
    #restday2 = []
    #for each in restday:
    #    restday2.extend(list(range(restday*24*timegap,(restday+1)*24*timegap)))
    
    ran_meeting = np.random.randint(7)
    meetingday = list(range(ran_meeting,timerange[-1],(ran_meeting+1)))
    
    ran_party = np.random.randint(30)
    partyday = list(range(ran_party,timerange[-1],(ran_party+1)))
    
    # default basic weekday
    df["dayType"] = 1
    # set party day
    partyday_index = [each for each in df.index if df.loc[each,"day"] in partyday]
    df["dayType"].loc[partyday_index] = 2
    # set meeting day
    meetingday_index = [each for each in df.index if df.loc[each,"day"] in meetingday]
    df["dayType"].loc[meetingday_index] = 3
    # set rest day
    restday_index = [each for each in df.index if df.loc[each,"day"] in restday]
    df["dayType"].loc[restday_index] = 0
    
    return df

def schedule(df):
    df["schedule"] = df[["dayType","hourOfDay"]].T.apply(lambda x: SCHDULE[x["dayType"]][x["hourOfDay"]])
    return df

timegap = _input
timerange = range(x*timegap)
df = daytype(timerange,timegap)
df = schedule(df)

output_ = df["hourOfYear"].values.tolist()
a = df["day"].values.tolist()
b = df["hourOfDay"].values.tolist()
c = df["dayType"].values.tolist()
d = df["schedule"].values.tolist()
# ---------- end gh_cpython ----------
panel_4 = Panel(gh_cpython.a)
panel_5 = Panel(gh_cpython.output)
# 建筑平面形态
# 建筑中庭位置
number_slider_3 = Slider(10, range=0..11)

panel_6 = Panel("""14
15
20
21""")
panel_7 = Panel("""0
1
6
7""")
panel_8 = Panel("""2
3
8
9""")
panel_9 = Panel("""4
5
10
11""")
panel_10 = Panel("""7
8
13
14""")
panel_11 = Panel("""16
17
22
23""")
panel_12 = Panel("""0
5
6
11""")
panel_13 = Panel("""18
19
22
23""")
panel_14 = Panel("""12
13
18
19""")
panel_15 = Panel("""12
17
18
23""")
panel_16 = Panel("""8
9
14
15""")
panel_17 = Panel("""9
10
15
16""")
panel_18 = Panel("""0
1
4
5""")
stream_filter = StreamFilter(
    Gate=number_slider_3,
    Stream0=panel_8,
    Stream1=panel_6,
    Stream2=panel_7,
    Stream3=panel_9,
    Stream4=panel_14,
    Stream5=panel_11,
    Stream6=panel_15,
    Stream7=panel_13,
    Stream8=panel_12,
    Stream9=panel_18,
    Stream10=panel_2,
    Stream11=panel_3)
panel_19 = Panel(stream_filter)

cull_index = CullIndex(List=isotrim, Indices=stream_filter, Wrap=True)
panel_20 = Panel(cull_index)
brep_wireframe = BrepWireframe(Brep=cull_index, Density=-1)
region_union = RegionUnion(Curves=cull_index)
join_curves = JoinCurves(Curves=region_union, Preserve=False)
panel_21 = Panel(region_union)
boundary_surfaces_2 = BoundarySurfaces(Edges=join_curves)
extrude = Extrude(Base=boundary_surfaces_2, Direction=unit_z)
brep_wireframe_2 = BrepWireframe(Brep=extrude, Density=-1)

number_slider_4 = Slider(1, range=0..1)  # disabled
discontinuity = Discontinuity(Curve=join_curves, Level=1)  # -> Points, Parameters; disabled
polyline = PolyLine(Vertices=discontinuity.Points, Closed=number_slider_4)  # disabled
number_slider_5 = Slider(0, range=0..100)  # disabled
number_slider_6 = Slider(16, range=0..100)  # disabled
explode = Explode(Curve=polyline, Recursive=True)  # -> Segments, Vertices; disabled
extend_curve = ExtendCurve(Curve=explode.Segments, Type=0, Start=number_slider_6, End=number_slider_5)  # disabled

brep_wireframe_3 = BrepWireframe(Brep=boundary_surfaces_2, Density=-1)
area_2 = Area(Geometry=boundary_surfaces_2)  # -> Area, Centroid
multiplication = Multiplication(A=area_2.Area, B=Slider(0.05, range=0..0.1))
division = Division(A=multiplication, B=Slider(4, range=0..10))
series = Series(Start=Slider(12, range=0..100), Step=1, Count=division)
# 内部空间划分
number_slider_7 = Slider(73, range=1..100)
number_slider_8 = Slider(73, range=0..100)
# 内部空间功能设定
number_slider_9 = Slider(0.45, range=0.05..0.5)

fast_loop_start = FastLoopStart(Iterations=Slider(28, range=0..100), Data=rectangle.Rectangle)  # -> port, Counter, Data
area_3 = Area(Geometry=fast_loop_start.Data)  # -> Area, Centroid
sort_list = SortList(Keys=area_3.Area, ValuesValuesA=fast_loop_start.Data)  # -> Keys, ValuesValuesA
split_list = SplitList(List=reverse(sort_list.ValuesValuesA), Index="1")  # -> ListA, ListB
explode_2 = Explode(Curve=split_list.ListA, Recursive=True)  # -> Segments, Vertices
length = Length(Curve=explode_2.Segments)
panel_22 = Panel("0.05017")
sort_list_2 = SortList(Keys=length, ValuesValuesA=explode_2.Segments)  # -> Keys, ValuesValuesA
area_4 = Area(Geometry=split_list.ListA)  # -> Area, Centroid
list_item_3 = ListItem(List=sort_list_2.ValuesValuesA, Index=0, Wrap=True)  # -> Item, Item1
construct_domain = ConstructDomain(DomainStart=Slider(0.35, range=0..1), DomainEnd=Slider(0.55, range=0..1))
division_2 = Division(A=area_4.Area, B=number_slider_9)
point_on_curve = PointOnCurve(list_item_3.Item1, parameter=0.5)
point_on_curve_2 = PointOnCurve(list_item_3.Item, parameter=0.5)
random = Random(Range=construct_domain, Number=1, Seed=division_2)
xy_plane = XYPlane(Origin=point_on_curve)
xy_plane_2 = XYPlane(Origin=point_on_curve_2)
vector = Vector(list_item_3.Item)
vector_2 = Vector(list_item_3.Item1)
align_plane = AlignPlane(Plane=xy_plane, Direction=vector_2)  # -> Plane, Angle
align_plane_2 = AlignPlane(Plane=xy_plane_2, Direction=vector)  # -> Plane, Angle
subtraction = Subtraction(A="1", B=random)
scale_nu = ScaleNU(Geometry=split_list.ListA, Plane=align_plane.Plane, ScaleX=1, ScaleY=subtraction, ScaleZ=1)  # -> Geometry, Transform
scale_nu_2 = ScaleNU(Geometry=split_list.ListA, Plane=align_plane_2.Plane, ScaleX=1, ScaleY=random, ScaleZ=1)  # -> Geometry, Transform
merge = Merge(Data1=split_list.ListB, Data2=scale_nu_2.Geometry, Data3=scale_nu.Geometry)  # -> flatten(Result)
fast_loop_end = FastLoopEnd(port=fast_loop_start.port, Exit=False, Data=merge, RecordData=False, TimeOutVal=0)

panel_23 = Panel(fast_loop_end)
boundary_surfaces_3 = BoundarySurfaces(Edges=fast_loop_end)
surface_split = SurfaceSplit(Surface=boundary_surfaces_3, Curves=brep_wireframe_3)
list_item_4 = ListItem(List=surface_split, Index=0, Wrap=True)  # -> flatten(Item)
area_5 = Area(Geometry=list_item_4)  # -> Area, Centroid

brep_topology = BrepTopology(PerspectiveOnly=False)  # -> FaceFaceAdjacency, FaceEdgeAdjacency, EdgeFaceAdjacency
brep_join = BrepJoin(Breps=list_item_4)  # -> Breps, Closed

point_in_curve = PointInCurve(Point=area_5.Centroid, Curve=join_curves)  # -> Relationship, Point

merge_faces = MergeFaces(Brep=brep_join.Breps)  # -> Breps, Before, After
area_6 = Area(Geometry=merge_faces.Breps)  # -> Area, Centroid
sort_list_3 = SortList(Keys=area_6.Area, ValuesValuesA=merge_faces.Breps)  # -> Keys, reverse(ValuesValuesA)
list_item_5 = ListItem(List=sort_list_3.ValuesValuesA, Index=0, Wrap=True)

cull_pattern = CullPattern(List=list_item_4, CullPattern=point_in_curve.Relationship)
panel_24 = Panel(cull_pattern)
area_7 = Area(Geometry=cull_pattern)  # -> Area, Centroid
merge_2 = Merge(Data1=number_slider_3, Data2=number_slider_7, Data3=number_slider_9, Data4=number_slider_8)
number_slider_10 = Slider(200, range=0..1000)
number_slider_11 = Slider(2, range=0..10)
number_slider_12 = Slider(1, range=0..1)
number_slider_13 = Slider(1, range=0..1)
number_slider_14 = Slider(1, range=0..1)

curve = Curve(<curve referenced from the Rhino model>)
divide_curve = DivideCurve(Curve=curve, Count=Slider(1, range=0..1), Kinks=False)  # -> Points, Tangents, Parameters
list_item_6 = ListItem(List=divide_curve.Points, Index=0, Wrap=True)  # -> Item, Item1
square = Square(Plane=list_item_6.Item, Size=Slider(55, range=0..100), ExtentX=Slider(1, range=0..100), ExtentY=Slider(2, range=0..10))  # -> Cells, flatten(Points)
square_2 = Square(Plane=list_item_6.Item1, Size=Slider(55, range=0..100), ExtentX=Slider(1, range=0..100), ExtentY=Slider(2, range=0..10))  # -> Cells, Points

series_2 = Series(Start=0, Step=Slider(4, range=0..10), Count=number_slider_10)
series_3 = Series(Start=Slider(2, range=0..10), Step=Slider(4, range=0..10), Count=number_slider_10)
series_4 = Series(Start=Slider(3, range=0..10), Step=Slider(4, range=0..10), Count=number_slider_10)
number_slider_15 = Slider(2, range=0..10)
number_slider_16 = Slider(20, range=0..100)
number_slider_17 = Slider(10, range=0..10)
number_slider_18 = Slider(36, range=0..100)
number_slider_19 = Slider(52, range=0..100)
series_5 = Series(Start=Slider(1, range=0..1), Step=Slider(4, range=0..10), Count=number_slider_10)
rectangular = Rectangular(
    Plane=list_item_6.Item1,
    SizeX=number_slider_18,
    SizeY=number_slider_19,
    ExtentX=number_slider_16,
    ExtentY=number_slider_17)  # -> Cells, Points
rectangular_2 = Rectangular(
    Plane=list_item_6.Item,
    SizeX=number_slider_18,
    SizeY=number_slider_19,
    ExtentX=number_slider_16,
    ExtentY=number_slider_17)  # -> Cells, Points
discontinuity_2 = Discontinuity(Curve=rectangular_2.Cells, Level=1)  # -> Points, Parameters
discontinuity_3 = Discontinuity(Curve=rectangular.Cells, Level=1)  # -> Points, Parameters
list_item_7 = ListItem(List=discontinuity_2.Points, Index=0, Wrap=True)
unit_x = UnitX(Factor=Slider(2, range=0..10))
list_item_8 = ListItem(List=discontinuity_3.Points, Index=0, Wrap=True)
unit_x_2 = UnitX(Factor=Slider(2, range=0..10))
unit_y = UnitY(Factor=Slider(2, range=0..10))
move = Move(Geometry=list_item_7, Motion=unit_x)  # -> Geometry, Transform
point = Point(flatten(list_item_7))
unit_y_2 = UnitY(Factor=Slider(2, range=0..10))
move_2 = Move(Geometry=list_item_8, Motion=unit_x_2)  # -> Geometry, Transform
move_3 = Move(Geometry=move.Geometry, Motion=unit_y)  # -> Geometry, Transform
point_list_2 = PointList(Points=point, Size=Slider(10, range=0..10))
move_4 = Move(Geometry=move_2.Geometry, Motion=unit_y_2)  # -> Geometry, Transform

mass2zone = Honeybee_Masses2Zones(zoneMasses=flatten(extrude), zonePrograms=list_item, maxRoofAngle=30, createHBZones=Slider(1, range=0..1))  # -> out, HBZones; plug-in component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
number_slider_20 = Slider(1, range=0..1)
gene_pool = GenePool(Decimals=2, Maximum=0.7, Minimum=0.3, Value=[0.37, 0.38, 0.41, 0.55])
glazingcreator = Honeybee_GlazingBasedOnRatio(HBObjects=mass2zone.HBZones, glzRatio=gene_pool, runIt=number_slider_20)  # -> out, HBObjWGLZ; plug-in component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
solveadjc = Honeybee_SolveAdjacencies(HBZones=flatten(glazingcreator.HBObjWGLZ), removeCurrentAdjc=False, findAdjc=number_slider_20)  # -> out, HBZonesWADJ; plug-in component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
genhbzonetestpts = Honeybee_GenerateZoneTestPoints(HBZone=solveadjc.HBZonesWADJ, gridSize=Slider(2, range=0..10), distBaseSrf=Slider(0.8, range=0..1), moveTestMesh=True)  # -> out, simplify(testPoints), simplify(ptsVectors), simplify(facesArea), simplify(mesh); plug-in component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
radparameters_2 = Honeybee_RADParameters(quality=Slider(0, range=0..100))  # -> out, radParameters; plug-in component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
brep_wireframe_4 = BrepWireframe(Brep=solveadjc.HBZonesWADJ, Density=-1)
number_slider_21 = Slider(1, range=0..1)

gridbasedsimulation = Honeybee_GridBasedSimulation(
    skyFile=genstandardciesky,
    testPoints=genhbzonetestpts.testPoints,
    ptsVectors=genhbzonetestpts.ptsVectors,
    testMesh=genhbzonetestpts.mesh,
    simulationType=0,
    radParameters=radparameters_2.radParameters)  # -> analysisRecipe; plug-in component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

rundaylightanalysis = Honeybee_RunDaylightSimulation(
    HBObjects=flatten(solveadjc.HBZonesWADJ),
    analysisRecipe=gridbasedsimulation,
    writeRad=number_slider_21,
    runRad=number_slider_21,
    numOfCPUs=Slider(4, range=0..10),
    overwriteResults=True)  # -> out, analysisType, resultsUnit, illuminance_values, testPts, illuminance_files, radGeoFile, studyFolder, done; plug-in component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

recolormesh = Ladybug_RecolorMesh(analysisResult=rundaylightanalysis.illuminance_values, inputMesh=genhbzonetestpts.mesh)  # -> out, newMesh, newLegend, legendBasePt, meshColors, legendColors; plug-in component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
mass_addition = MassAddition(Input=rundaylightanalysis.illuminance_values)  # -> Result, PartialResults
panel_25 = Panel(mass_addition.Result)
panel_26 = Panel(rundaylightanalysis.illuminance_values)
mesh_explode = MeshExplode(Mesh=genhbzonetestpts.mesh, Interpolate=False)
sort_list_4 = SortList(Keys=rundaylightanalysis.illuminance_values, ValuesValuesA=mesh_explode)  # -> Keys, ValuesValuesA
list_item_9 = ListItem(List=sort_list_4.ValuesValuesA, Index=series, Wrap=True)
deconstruct_mesh = DeconstructMesh(Mesh=list_item_9)  # -> flatten(Vertices), Faces, Colours, Normals
point_2 = Point(deconstruct_mesh.Vertices)

circle_fit = CircleFit(Points=deconstruct_mesh.Vertices)  # -> Circle, Radius, Deviation; disabled
number_slider_22 = Slider(0.7, range=0..1)  # disabled
number_slider_23 = Slider(0.3, range=0.1..0.5)  # disabled
area_8 = Area(Geometry=circle_fit.Circle)  # -> Area, Centroid; disabled
number_slider_24 = Slider(0.5, range=0..1)  # disabled
scale = Scale(Geometry=circle_fit.Circle, Center=area_8.Centroid, Factor=number_slider_22)  # -> Geometry, Transform; disabled
addition = Addition(A=number_slider_23, B=number_slider_24)  # disabled
evaluate_curve = EvaluateCurve(Curve=reparameterize(scale.Geometry), Parameter=number_slider_23)  # -> Point, Tangent, Angle; disabled
evaluate_curve_2 = EvaluateCurve(Curve=reparameterize(scale.Geometry), Parameter=addition)  # -> Point, Tangent, Angle; disabled

list_length = ListLength(List=point_2)
subtraction_2 = Subtraction(A=list_length, B=Slider(2, range=0..10))
random_reduce = RandomReduce(List=point_2, Reduction=subtraction_2, Seed=number_slider_7)
list_item_10 = ListItem(List=random_reduce, Index=0, Wrap=True)  # -> Item, Item1

closest_point = ClosestPoint(Point=list_item_10.Item1, Cloud=area_7.Centroid)  # -> ClosestPoint, CPIndex, Distance
closest_point_2 = ClosestPoint(Point=list_item_10.Item, Cloud=area_7.Centroid)  # -> ClosestPoint, CPIndex, Distance
list_item_11 = ListItem(List=cull_pattern, Index=[closest_point_2.CPIndex, closest_point.CPIndex], Wrap=True)
extrude_2 = Extrude(Base=list_item_11, Direction=unit_z_2)
move_5 = Move(Geometry=extrude_2, Motion=unit_z_3)  # -> Geometry, Transform
solid_difference = SolidDifference(BrepsA=extrude, BrepsB=move_5.Geometry)
panel_27 = Panel(solid_difference)
merge_3 = Merge(Data1=boundary_surfaces_2, Data2=list_item_11)

number_slider_25 = Slider(6, range=0..10)
panel_28 = Panel("""4
1
1""")
list_item_12 = ListItem(List=panel_28, Index=0, Wrap=True)  # -> Item, Item1, Item2
division_3 = Division(A=list_item_12.Item, B=number_slider_25)
division_4 = Division(A=list_item_12.Item1, B=number_slider_25)
division_5 = Division(A=list_item_12.Item2, B=number_slider_25)

# ----
# 休闲空间
# 办公空间
cull_index_2 = CullIndex(List=cull_pattern, Indices=[closest_point_2.CPIndex, closest_point.CPIndex], Wrap=True)
area_9 = Area(Geometry=cull_index_2)  # -> Area, Centroid
list_length_2 = ListLength(List=cull_index_2)
series_6 = Series(Start=0, Step=1, Count=list_length_2)

list_length_3 = ListLength(List=cull_index_2)
multiplication_2 = Multiplication(A=division_5, B=list_length_3)
multiplication_3 = Multiplication(A=division_4, B=list_length_3)
multiplication_4 = Multiplication(A=division_3, B=list_length_3)
round = Round(Number=multiplication_4)  # -> Nearest, Floor, Ceiling
round_2 = Round(Number=multiplication_3)  # -> Nearest, Floor, Ceiling
subtraction_3 = Subtraction(A=list_length_3, B=round.Nearest, C=round_2.Nearest)

area_10 = Area(Geometry=cull_index_2)  # -> Area, Centroid
point_list_3 = PointList(Points=area_10.Centroid, Size=Slider(3, range=0..10))

random_reduce_2 = RandomReduce(List=cull_index_2, Reduction=round.Nearest, Seed=number_slider_8)

area_11 = Area(Geometry=random_reduce_2)  # -> Area, Centroid
closest_point_3 = ClosestPoint(Point=area_11.Centroid, Cloud=area_9.Centroid)  # -> ClosestPoint, CPIndex, Distance
cull_index_3 = CullIndex(List=series_6, Indices=closest_point_3.CPIndex, Wrap=True)
split_list_2 = SplitList(List=random_reduce_2, Index=subtraction_3)  # -> ListA, ListB
list_item_13 = ListItem(List=cull_index_2, Index=cull_index_3, Wrap=True)
# 交流空间
brep = Brep(split_list_2.ListB)
brep_2 = Brep(split_list_2.ListA)

panel_29 = Panel(cull_index_2)

brep_wireframe_5 = BrepWireframe(Brep=cull_index_2, Density=-1)  # -> flatten(Wireframe)
colour = Colour("49,38,230")
colour_2 = Colour("10,237,1")
colour_3 = Colour("226,5,20")
custom_preview = CustomPreview(Geometry=brep, Material=colour_3)
custom_preview_lineweights = CustomPreviewLineweights(
    Geometry=brep_wireframe_5,
    Shader=ColourSwatch(SwatchColor=RGB(0, 0, 0)),
    Thickness=Slider(5, range=0..10),
    Absolute=False)
custom_preview_2 = CustomPreview(Geometry=brep_2, Material=colour)
custom_preview_3 = CustomPreview(Geometry=list_item_13, Material=colour_2)

area_12 = Area(Geometry=brep_2)  # -> Area, Centroid
area_13 = Area(Geometry=list_item_13)  # -> Area, Centroid
area_14 = Area(Geometry=brep)  # -> Area, Centroid
panel_30 = Panel(brep_2)
panel_31 = Panel(area_14.Area)
panel_32 = Panel(area_13.Area)
panel_33 = Panel(area_12.Area)
panel_34 = Panel(area_12.Centroid)
gh_cpython_2 = GH_CPython(
    input=Slider(1, range=0..1),
    x=area_12.Area,
    y=area_14.Area,
    z=area_13.Area,
    u=area_12.Centroid,
    v=area_14.Centroid,
    w=area_13.Centroid,
    s=number_slider_3,
    t=number_slider_7,
    xx=number_slider_9,
    xy=number_slider_8)  # -> output, a, b, c; inputs input: list, x: list, y: list, z: list, u: list, v: list, w: list, s: list, t: list, xx: list, xy: list
# ---------- gh_cpython_2: Python ----------
#  -*-coding:utf8 -*-
""" 
Python Script
Created on  Friday July 2021 10:47:27 
@author:  A434 

[desc]
Description of the plugin Here
Write here any thing... 
[/desc]

ARGUMENTS:
----------
<inp> 
    _input :[required] - [type = int] - [default = None] 
    Descripe your input here 
        * bullet point.
        * bullet point
</inp>
<inp>
    Other inputs go here ...
</inp>

RETURN:
----------
    <out>
        output_ : indicate your output description here. \n refers to a new line.
    </out>

"""
#x xiuxian
#y jiaoliu
#z bangong

import numpy as np
import pandas as pd

output_ = None
if _input == 1:
     office = list(z)
     communicate = list(y)
     relax = list(x)

     office_count = len(office)
     communicate_count = len(communicate)
     relax_count = len(relax)
     df = pd.DataFrame(columns = ["area","personcount","roomtype"])
     a = office.copy()
     a.extend(communicate)
     a.extend(relax)
     df["area"] = a
     df["roomtype"].iloc[list(range(office_count))] = 0
     df["roomtype"].iloc[list(range(office_count,office_count+communicate_count))] = 1
     df["roomtype"].iloc[list(range(office_count+communicate_count,
                                    office_count+communicate_count+relax_count))] = 2

     df["personcount"] = df["area"]//1
     df["personcount"][df["roomtype"]==0] = df["area"][df["roomtype"]==0]//4

     center_x = [each[0] for each in w]
     center_x.extend([each[0] for each in v])
     center_x.extend([each[0] for each in u])

     center_y = [each[1] for each in w]
     center_y.extend([each[1] for each in v])
     center_y.extend([each[1] for each in u])

     df["centerX"] = center_x
     df["centerY"] = center_y
     
     output_ = df["area"].values.tolist()
     c = df["roomtype"].values.tolist()
     b = df["personcount"].values.tolist()
     a = office_count

     name = "_".join([str(each) for each in [s,t,xx,xy]])
     df.to_csv("E:\\Tong\\result\\"+name+"room.csv",encoding = "utf-8")
# ---------- end gh_cpython_2 ----------
gh_cpython_3 = GH_CPython(input=panel_34)  # -> output; inputs input: list
# ---------- gh_cpython_3: Python ----------
# -*- coding: utf-8 -*-
""" 
Python Script
Created on  Friday July 2021 04:32:23 
@author:  A434 

[desc]
Description of the plugin Here
Write here any thing... 
[/desc]

ARGUMENTS:
----------
<inp> 
    _input :[required] - [type = int] - [default = None] 
    Descripe your input here 
        * bullet point.
        * bullet point
</inp>
<inp>
    Other inputs go here ...
</inp>

RETURN:
----------
    <out>
        output_ : indicate your output description here. \n refers to a new line.
    </out>

"""
print(_input[0][1])
# ---------- end gh_cpython_3 ----------
panel_35 = Panel(gh_cpython_2.c)
panel_36 = Panel(gh_cpython_2.output)
gh_cpython_4 = GH_CPython(
    input=gh_cpython_2.output,
    xx=gh_cpython_2.b,
    xy=gh_cpython_2.c,
    x=gh_cpython_2.a,
    y=number_slider_2,
    z=number_slider,
    u=gh_cpython.output,
    v=gh_cpython.a,
    w=gh_cpython.b,
    s=gh_cpython.c,
    t=gh_cpython.d,
    xz=number_slider_3,
    xu=number_slider_7,
    xv=number_slider_9,
    xw=number_slider_8)  # -> output, a, b; inputs input: list, xx: list, xy: list, x: list, y: list, z: list, u: list, v: list, w: list, s: list, t: list, xz: list, xu: list, xv: list, xw: list
# ---------- gh_cpython_4: Python ----------
# -*- coding: utf-8 -*-
""" 
Python Script
Created on  Wednesday June 2021 07:46:43 
@author:  A434 

[desc]
Description of the plugin Here
Write here any thing... 
[/desc]

ARGUMENTS:
----------
<inp> 
    _input :[required] - [type = int] - [default = None] 
    Descripe your input here 
        * bullet point.
        * bullet point
</inp>
<inp>
    Other inputs go here ...
</inp>

RETURN:
----------
    <out>
        output_ : indicate your output description here. \n refers to a new line.
    </out>

"""
import numpy as np
import pandas as pd

# -------create moving property matrix---------
def p_communicate(person_inroom,person_status,currenttimestep):
    # communication property
    p_indoor_com = 0.3
    p_not_move = 0.6
    p_ourdoor_com = 0.1
    move = person_status[currenttimestep-1,:] == person_inroom
    p = np.ones(person_inroom.shape)
    p[move] = p_indoor_com + p_not_move
    return p

def p_arrive():
    pass

def p_relax(conworktime,timegap):
    # linear
    p = conworktime/timegap * 0.1
    return p

def p_meeting():
    pass

def p_leave():
    pass

# ------judge status-------
"""
def worktime(person_status,currenttimestep,timegap,relax_zone):
    conworktime = np.zeros(person_status.shape[1])
    for timeperiod in range(1,timegap*5):
        to_relax = person_status[currenttimestep - timeperiod,:] == relax_zone
        work = np.zeros(person_status.shape[1])
        work[~to_relax] = 1
        conworktime += work
    return conworktime
"""
def worktime(conworktime,person_status,currenttimestep,person_inroom,meeting_room,relax_zone):
    relax = ((person_status[currenttimestep,:] == relax_zone) |
            (person_status[currenttimestep,:] == 999))
    work = ~relax
    conworktime[relax] = 0
    conworktime[work] += 1
    return conworktime

def communication_destination(communicate_status,person_inroom,person_status,room_count):
    com_person_count = len(person_status[communicate_status])
    randroom = np.random.randint(0,room_count,size = com_person_count)
    #basicroom = person_inroom[communicate_status]
    person_status[communicate_status] = randroom
    return person_status
    

# ------generate data-------
def generate_personInRoom(person_status,currenttimestep,tot_room_count):
    status_slice = person_status[currenttimestep,:]
    room_count_status_slice = []
    for each in range(tot_room_count):
        room_count_status_slice.append(len(status_slice[status_slice == each]))
    return room_count_status_slice

timegap = y
timerange = range(y*z)
room_count = x
roomdf = pd.DataFrame()
roomdf["area"] = _input
roomdf["light"] = roomdf["area"]*9
roomdf["personcount"] = xx
roomdf["roomtype"] = xy
df = pd.DataFrame()
df["hourOfYear"] = u
df["day"] = v
df["hourOfDay"] = w
df["dayType"] = s
df["schedule"] = t
output_ = roomdf

person_count = int(roomdf[roomdf["roomtype"]==0]["personcount"].sum())
tot_room_count = len(roomdf)
person_inroom = []
for eachindex in roomdf[roomdf["roomtype"]==0].index:
    count = roomdf.loc[eachindex,"personcount"]
    person_inroom.extend([eachindex] * int(count))
person_inroom = np.array(person_inroom)

meeting_count = len(roomdf[roomdf["roomtype"]==1])
meeting_room = np.random.randint(0,meeting_count,size = person_count) + room_count

relax_count = len(roomdf[roomdf["roomtype"]==2])
relax_zone = np.random.randint(0,relax_count,size = person_count) + room_count + meeting_count


person_status = np.zeros((timerange[-1]+1,person_count))
light_status = np.zeros((timerange[-1]+1,tot_room_count))
conworktime = np.zeros(person_count)
room_count_status = np.zeros((timerange[-1]+1,tot_room_count))

for eachtimestep in timerange:
    
    
    if df.loc[eachtimestep,"schedule"] == 1: 
        #arrive
        person_status[eachtimestep,:] = person_inroom
        light_status[eachtimestep,:] = 1
    elif df.loc[eachtimestep,"schedule"] == 2: 
        #leaving
        person_status[eachtimestep,:] = 999
        light_status[eachtimestep,:] = 0
    elif df.loc[eachtimestep,"schedule"] == 3: 
        #meeting
        person_status[eachtimestep,:] = meeting_room
        light_status[eachtimestep,:room_count] = 0
        light_status[eachtimestep,room_count:room_count+meeting_count] = 1
    elif df.loc[eachtimestep,"schedule"] == 4:
        #relax
        person_status[eachtimestep,:] = person_inroom
        light_status[eachtimestep,:] = 0
    elif df.loc[eachtimestep,"schedule"] == 5:
        #meals
        random_meals = np.random.randint(0,2,size = person_count)
        to_relax = random_meals == 0
        person_status[eachtimestep,to_relax] = relax_zone[to_relax]
        person_status[eachtimestep,~to_relax] = 999
        light_status[eachtimestep,:] = 1
    else:
        #default in room
        person_status[eachtimestep,:] = person_inroom
        #communication or work
        is_relax = conworktime == 0
        person_status[eachtimestep,is_relax] = person_inroom[is_relax]
        
        p = p_relax(conworktime,timegap)
        random_relax = np.random.random(person_count)
        to_relax = random_relax < p
        to_relax = to_relax & ~is_relax
        person_status[eachtimestep,to_relax] = relax_zone[to_relax]
        
        p = p_communicate(person_inroom,person_status,eachtimestep)
        random_communicate = np.random.random(person_count)
        to_communicate = random_communicate > p
        to_communicate = to_communicate & ~is_relax & ~to_relax
        person_status[eachtimestep,:] = communication_destination(to_communicate,
                                                                  person_inroom,
                                                                  person_status[eachtimestep,:],
                                                                  room_count)
        light_status[eachtimestep,:] = 1
        
        
    #calculate work time
    conworktime = worktime(conworktime,person_status,eachtimestep,
                           person_inroom,meeting_room,relax_zone)
    #calculate person in rooms
    room_count_status[eachtimestep,:] = generate_personInRoom(person_status,
                                                              eachtimestep,
                                                              tot_room_count)
    #light status
    room_zero = room_count_status[eachtimestep,:] == 0
    light_status[eachtimestep,:][room_zero] = 0

light_se = light_status.sum(axis = 0) * roomdf["light"] * 60*30/1000/3600
office = roomdf[roomdf["roomtype"]==0].index
output_ = light_se[office].values.tolist()
a = light_se[roomdf[roomdf["roomtype"]==1].index].values.tolist()
b = light_se[roomdf[roomdf["roomtype"]==2].index].values.tolist()

lis = [xz,xu,xv,xw]
lis = [str(each) for each in lis]
name = "_".join(lis)
pd.DataFrame(person_status).to_csv("E://Tong//result//"+name+"_person_status.csv",encoding = "utf-8")
pd.DataFrame(light_se).to_csv("E://Tong//result//"+name+"_light_se.csv",encoding = "utf-8")
pd.DataFrame(light_status).to_csv("E://Tong//result//"+name+"_light_status.csv",encoding = "utf-8")

#c = relax_zone
# ---------- end gh_cpython_4 ----------
panel_37 = Panel(gh_cpython_4.b)
panel_38 = Panel(gh_cpython_4.a)
panel_39 = Panel(gh_cpython_4.output)
# 办公空间
# 交流空间
# 休闲空间
mass_addition_2 = MassAddition(Input=[gh_cpython_4.output, gh_cpython_4.a, gh_cpython_4.b])  # -> Result, PartialResults
panel_40 = Panel(mass_addition_2.Result)
# 房间划分
stack_trees = StackTrees(Data0=brep_2, Data1=brep, Data2=list_item_13, Reduce=True)

number_slider_26 = Slider(1, range=0..1)
mass2zone_2 = Honeybee_Masses2Zones(zoneMasses=flatten(solid_difference), zonePrograms=list_item_2, maxRoofAngle=30, createHBZones=Slider(1, range=0..1))  # -> out, HBZones; plug-in component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
glazingcreator_2 = Honeybee_GlazingBasedOnRatio(HBObjects=mass2zone_2.HBZones, glzRatio=gene_pool, runIt=number_slider_26)  # -> out, HBObjWGLZ; plug-in component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
solveadjc_2 = Honeybee_SolveAdjacencies(HBZones=flatten(glazingcreator_2.HBObjWGLZ), removeCurrentAdjc=False, findAdjc=number_slider_26)  # -> out, HBZonesWADJ; plug-in component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
genhbzonetestpts_2 = Honeybee_GenerateZoneTestPoints(HBZone=solveadjc_2.HBZonesWADJ, gridSize=Slider(2, range=0..10), distBaseSrf=Slider(0.8, range=0..1), moveTestMesh=True)  # -> out, simplify(testPoints), simplify(ptsVectors), simplify(facesArea), simplify(mesh); plug-in component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
# Sum EUI
# Visualize EUI
brep_wireframe_6 = BrepWireframe(Brep=solveadjc_2.HBZonesWADJ, Density=-1)
number_slider_27 = Slider(1, range=0..1)

gridbasedsimulation_2 = Honeybee_GridBasedSimulation(
    skyFile=genstandardciesky_2,
    testPoints=genhbzonetestpts_2.testPoints,
    ptsVectors=genhbzonetestpts_2.ptsVectors,
    testMesh=genhbzonetestpts_2.mesh,
    simulationType=0,
    radParameters=radparameters.radParameters)  # -> analysisRecipe; plug-in component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

rundaylightanalysis_2 = Honeybee_RunDaylightSimulation(
    HBObjects=flatten(solveadjc_2.HBZonesWADJ),
    analysisRecipe=gridbasedsimulation_2,
    writeRad=number_slider_27,
    runRad=number_slider_27,
    numOfCPUs=Slider(4, range=0..10),
    overwriteResults=True)  # -> out, analysisType, resultsUnit, illuminance_values, testPts, illuminance_files, radGeoFile, studyFolder, done; plug-in component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

recolormesh_2 = Ladybug_RecolorMesh(analysisResult=rundaylightanalysis_2.illuminance_values, inputMesh=genhbzonetestpts_2.mesh)  # -> out, newMesh, newLegend, legendBasePt, meshColors, legendColors; plug-in component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
mass_addition_3 = MassAddition(Input=rundaylightanalysis_2.illuminance_values)  # -> Result, PartialResults
smaller_than = SmallerThan(FirstNumber=rundaylightanalysis_2.illuminance_values, SecondNumber=Slider(2000, range=0..10000))  # -> SmallerThan, OrEqualTo
larger_than = LargerThan(FirstNumber=rundaylightanalysis_2.illuminance_values, SecondNumber=Slider(300, range=0..10000))  # -> LargerThan, OrEqualTo
subtraction_4 = Subtraction(A=mass_addition_3.Result, B=mass_addition.Result)
gate_and = GateAnd(A=smaller_than.SmallerThan, B=larger_than.LargerThan)
mass_addition_4 = MassAddition(Input=gate_and)  # -> Result, PartialResults
list_length_4 = ListLength(List=rundaylightanalysis_2.illuminance_values)
panel_41 = Panel(rundaylightanalysis_2.illuminance_values)
division_6 = Division(A=mass_addition_4.Result, B=list_length_4)
one_over_x = OneOverX(Value=division_6)

wlc_energy_sum_min = Number(mass_addition_2.Result)
wlc_illuminance_max = Number(one_over_x)

# ----
# 照明
# 能耗
number = Number(division_6)
# 建筑边界+中庭
number_2 = Number(wlc_energy_sum_min)
merge_4 = Merge(Data1=number, Data2=number_2)  # -> flatten(Result)
panel_42 = Panel(merge_4)

wallacei_x = WallaceiX(
    Genes=[number_slider_3, number_slider_7, number_slider_9, number_slider_8],
    Objectives=[wlc_energy_sum_min, wlc_illuminance_max],
    Phenotype=[merge_3, merge_4, merge_2],
    allFitness="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",
    allFrontIdx="29|6;33|7;36|8;39|6;39|7;40|7;44|9;47|7;47|8",
    allGenomes="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",
    curFrontIdx="49|0;49|1;49|2;49|3;49|4;49|5;49|6;49|7;49|8",
    curFrontIdxSave="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",
    popGen="50,50",
    total="58270078",
    wlcDone=True)  # -> WallaceiGenomes, FitnessValues, Data, Phenotypes
decode_phenotype = DecodePhenotype(WallaceiPhenotype=wallacei_x.Phenotypes)  # -> GeometriesList, MeshesList, NumbersList, TextList
panel_43 = Panel(decode_phenotype.NumbersList)
gh_cpython_5 = GH_CPython(input=decode_phenotype.NumbersList)  # -> output; inputs input: list
# ---------- gh_cpython_5: Python ----------
# -*- coding: utf-8 -*-
""" 
Python Script
Created on  Friday July 2021 05:04:48 
@author:  A434 

[desc]
Description of the plugin Here
Write here any thing... 
[/desc]

ARGUMENTS:
----------
<inp> 
    _input :[required] - [type = int] - [default = None] 
    Descripe your input here 
        * bullet point.
        * bullet point
</inp>
<inp>
    Other inputs go here ...
</inp>

RETURN:
----------
    <out>
        output_ : indicate your output description here. \n refers to a new line.
    </out>

"""
import pandas as pd

df = pd.DataFrame()
ne = []
for each in _input:
    each_new = [eachi for eachi in each if eachi <1000]
    each_new1 = [eachi for eachi in each if eachi >1000]
    each_new.extend(each_new1)
    ne.append(each_new)

df["i"] = [each[1] for each in ne]
df["j"] = [each[2] for each in ne]
df["k"] = [each[3] for each in ne]
df["l"] = [each[4] for each in ne]
df["illu"] = [each[0] for each in ne]
df["energy"] = [each[-1] for each in ne]

df.to_csv("E://Tong//result.csv",encoding = "utf-8")
# ---------- end gh_cpython_5 ----------
path_mapper = PathMapper(decode_phenotype.GeometriesList, source=["{A;B;C}", "{A;B;C;D;E;F;G}"], target=["{path_index}", "{path_index}"])
panel_44 = Panel(path_mapper)

# ----
# 休闲
# 交流
# 办公
ghpython_script = GhPythonScript(x=panel_44)  # -> out, a, b, c, d; inputs x: tree; disabled
# ---------- ghpython_script: Python ----------
__author__ = "A434"
__version__ = "2021.07.01"

import rhinoscriptsyntax as rs
from Grasshopper import DataTree

i = 0
path = x.Paths
branch = x.Branches
a = DataTree[object]()
b = DataTree[object]()
c = DataTree[object]()
d = DataTree[object]()
for j in range(len(path)):
    if i == 1:
        a.AddRange(branch[j],path[j])
        out =branch[j][0]
        #print(type(new))
        #a.MergeTree(new)
        pass
    if i == 0:
        b.AddRange(branch[j],path[j])
    if i == 2:
        c.AddRange(branch[j],path[j])
    if i == 3:
        d.AddRange(branch[j],path[j])
    i = i + 1
    if i == 4:
        i = 0
#a = new
# ---------- end ghpython_script ----------
surface = Surface(ghpython_script.a)  # disabled
brep_3 = Brep(ghpython_script.a)  # disabled
panel_45 = Panel(ghpython_script.a)  # disabled
panel_46 = Panel(ghpython_script.c)  # disabled
panel_47 = Panel(ghpython_script.b)  # disabled
panel_48 = Panel(ghpython_script.d)  # disabled

brep_4 = Brep(decode_phenotype.GeometriesList)  # disabled
path_mapper_2 = PathMapper(brep_4, source=["{A;B;C}", "{A;B;C;D;E;F;G}"], target=["{path_index}", "{path_index}"])  # disabled
tree_branch = TreeBranch(Tree=path_mapper_2, MaintainPaths=True)  # disabled
panel_49 = Panel(tree_branch)  # disabled
param_viewer = ParamViewer(tree_branch)  # disabled

number_slider_28 = Slider(600, range=0..1000)  # disabled
number_slider_29 = Slider(4, range=0..10)  # disabled
series_7 = Series(Start=0, Step=1, Count=number_slider_28)  # disabled
partition_list = PartitionList(List=series_7, Size=number_slider_29)  # -> simplify(Chunks); disabled
ghpython_script_2 = GhPythonScript(x=partition_list)  # -> out, a; inputs x: tree of Int32; disabled
# ---------- ghpython_script_2: Python ----------
__author__ = "A434"
__version__ = "2021.07.01"

import rhinoscriptsyntax as rs

a = []
print(x)
# ---------- end ghpython_script_2 ----------
panel_50 = Panel(partition_list)  # disabled
panel_51 = Panel(ghpython_script_2.a)  # disabled
number_slider_30 = Slider(49, range=0..100)  # disabled
number_slider_31 = Slider(9, range=0..10)  # disabled
number_slider_32 = Slider(14, range=0..100)  # disabled
area_15 = Area(Geometry=brep_4)  # -> Area, Centroid; disabled
point_3 = Point(<point referenced from the Rhino model>)  # disabled
square_3 = Square(Plane=point_3, Size=number_slider_30, ExtentX=number_slider_32, ExtentY=number_slider_31)  # -> Cells, flatten(Points); disabled
list_item_14 = ListItem(List=area_15.Centroid, Index=0, Wrap=True)  # disabled
orient = Orient(Geometry=brep_4, Source=list_item_14, Target=graft(square_3.Points))  # -> Geometry, Transform; disabled

# ----
# 休闲
# 交流
tree_branch_index = TreeBranchIndex(DataTree=path_mapper, BranchIndex=series_2)
tree_branch_index_2 = TreeBranchIndex(DataTree=path_mapper, BranchIndex=series_3)
# 办公
tree_branch_index_3 = TreeBranchIndex(DataTree=path_mapper, BranchIndex=series_4)
tree_branch_index_4 = TreeBranchIndex(DataTree=path_mapper, BranchIndex=series_5)
list_item_15 = ListItem(List=tree_branch_index_4, Index=0, Wrap=True)
cull_index_4 = CullIndex(List=tree_branch_index_4, Indices=Slider(0, range=0..100), Wrap=True)
panel_52 = Panel(list_item_15)
orient_2 = Orient(Geometry=cull_index_4, Source=PlaneXY(0, 0, 0), Target=graft(move_3.Geometry))  # -> Geometry, Transform
orient_3 = Orient(Geometry=list_item_15, Source=PlaneXY(0, 0, 0), Target=graft(move_3.Geometry))  # -> Geometry, Transform

orient_4 = Orient(Geometry=tree_branch_index_3, Source=PlaneXY(0, 0, 0), Target=graft(move_3.Geometry))  # -> Geometry, Transform
orient_5 = Orient(Geometry=tree_branch_index_2, Source=PlaneXY(0, 0, 0), Target=graft(move_3.Geometry))  # -> Geometry, Transform
orient_6 = Orient(Geometry=tree_branch_index, Source=PlaneXY(0, 0, 0), Target=graft(move_3.Geometry))  # -> Geometry, Transform

orient_7 = Orient(Geometry=cull_index_4, Source=PlaneXY(0, 0, 0), Target=graft(move_4.Geometry))  # -> Geometry, Transform
orient_8 = Orient(Geometry=list_item_15, Source=PlaneXY(0, 0, 0), Target=graft(move_4.Geometry))  # -> Geometry, Transform

colour_4 = Colour("49,38,230")
colour_5 = Colour("10,237,1")
colour_6 = Colour("226,5,20")
custom_preview_4 = CustomPreview(Geometry=orient_5.Geometry, Material=colour_6)
custom_preview_5 = CustomPreview(Geometry=orient_4.Geometry, Material=colour_5)
custom_preview_6 = CustomPreview(Geometry=orient_6.Geometry, Material=colour_4)

brep_wireframe_7 = BrepWireframe(Brep=[orient_3.Geometry, orient_2.Geometry], Density=-1)  # -> flatten(Wireframe)
custom_preview_lineweights_2 = CustomPreviewLineweights(
    Geometry=brep_wireframe_7,
    Shader=ColourSwatch(SwatchColor=RGB(0, 0, 0)),
    Thickness=Slider(5, range=0..10),
    Absolute=False)

brep_wireframe_8 = BrepWireframe(Brep=[orient_7.Geometry, orient_8.Geometry], Density=-1)  # -> flatten(Wireframe)
panel_53 = Panel(orient_6.Geometry)
custom_preview_lineweights_3 = CustomPreviewLineweights(
    Geometry=brep_wireframe_8,
    Shader=ColourSwatch(SwatchColor=RGB(0, 0, 0)),
    Thickness=Slider(5, range=0..10),
    Absolute=False)
brep_wireframe_9 = BrepWireframe(Brep=orient_6.Geometry, Density=-1)
brep_wireframe_10 = BrepWireframe(Brep=orient_5.Geometry, Density=-1)
brep_wireframe_11 = BrepWireframe(Brep=orient_4.Geometry, Density=-1)
custom_preview_lineweights_4 = CustomPreviewLineweights(
    Geometry=[brep_wireframe_9, brep_wireframe_10, brep_wireframe_11],
    Shader=ColourSwatch(SwatchColor=RGB(0, 0, 0)),
    Thickness=Slider(5, range=0..10),
    Absolute=False)
